# Grasshopper definition Solihiya.gh (Grasshopper 1.0.7)
# plug-ins: Kangaroo2 Components, Bifocals, Weaverbird

number_slider = Slider(40, range=0..40)
number_slider_2 = Slider(0, range=0..10)
crv = Curve(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)
solangle = GetNumber(AtLeast=1, AtMost=1, Maximum=180, Minimum=-1.797693135e+308)
tod = GetNumber(AtLeast=1, AtMost=1, Maximum=9, Minimum=-1.797693135e+308)
smlopening = GetNumber(number_slider, AtLeast=1, AtMost=1, Maximum=40, Minimum=-1.797693135e+308)
lrgopening = GetNumber(number_slider_2, AtLeast=1, AtMost=1, Maximum=40, Minimum=-1.797693135e+308)
zheight = GetNumber(Slider(0.05, range=0..0.05), AtLeast=1, AtMost=1, Maximum=0.05, Minimum=-1.797693135e+308)
explode = Explode(Curve=crv, Recursive=True)  # -> Segments, Vertices
boundary = BoundarySurfaces(Edges=crv)
bbox = BoundingBox(Content=crv, Plane=PlaneXY(0, 0, 0))  # -> Box, Box_2
mesh = MeshBrep(
    Brep=boundary,
    Settings={GridMaxCount=0, GridMinCount=16, JaggedSeams=False, MaxEdgeLength=0, MinEdgeLength=0.0001, MinTolerance=0, Refine=True, RefineAngle=0, RelativeTolerance=0.65, SimplePlanes=True, Tolerance=0})
debrep = DeconstructBrep(Brep=bbox.Box)  # -> Faces, Edges, Vertices
qrsettings = QuadRemeshSettings(TargetCount=1000, AdaptiveSize=0, AdaptiveCount=invert(False), HardEdges=False, SeamEdges=0, Symmetry=0, GuideCurves=0)
area = Area(Geometry=debrep.Faces)  # -> Area, Centroid
xy = XYPlane(Origin=Point(0, 0, 0))
qrmesh = QuadRemesh(Mesh=mesh, Settings=qrsettings)
sqrt = SquareRoot(Value=area.Area)
circle = CircleCNR(Center=area.Centroid, Normal=xy, Radius=sqrt)

nv = NakedVertices(Mesh=qrmesh)  # -> ClothedIndex, NakedIndex, ClothedPts, NakedPts
cull = CullPattern(List=explode.Segments, CullPattern=[False, True])
pull = PullPoint(Point=nv.NakedPts, Geometry=cull, ClosestOnly=True)  # -> ClosestPoint, Distance
smaller = SmallerThan(FirstNumber=pull.Distance, SecondNumber=Slider(1e-05, range=0..1e-05))  # -> SmallerThan, OrEqualTo
cull_2 = CullPattern(List=pull.ClosestPoint, CullPattern=smaller.OrEqualTo)
pt = Point(cull_2)
anchor = Anchor(Point=pt, Strength=10000)

sph = Sphere(Base=area.Centroid, Radius=sqrt)
divide = DivideCurve(Curve=circle, Count="2", Kinks=False)  # -> Points, Tangents, Parameters
item = ListItem(List=divide.Points, Index=0, Wrap=True)  # -> Item, Item1
geodesic = Geodesic(Surface=sph, Start=item.Item, End=item.Item1)
ln = Line(StartPoint=item.Item, EndPoint=item.Item1)
rad = Radians(Degrees=Slider(43, range=0..180))
neg = Negative(Value=rad)
edgelengths = EdgeLengths(Mesh=qrmesh, LengthFactor="1", Strength=1)
vertexloads = VertexLoads(Mesh=qrmesh, Strength=zheight)
rot3d = Rotate3D(Geometry=geodesic, Angle=neg, Center=area.Centroid, Axis=ln)  # -> Geometry, Transform
show = Show(G=qrmesh)
divide_2 = DivideCurve(Curve=rot3d.Geometry, Count=10, Kinks=False)  # -> Points, Tangents, Parameters
merge = Merge(Data1=show, Data2=anchor, Data3=vertexloads, Data4=edgelengths)
item_2 = ListItem(List=divide_2.Points, Index=Slider(5, range=1..9), Wrap=True)
zombiesolver = ZombieSolver(GoalObjects=merge, Threshold=1e-10, Tolerance=0.0001, MaxIterations=50000)  # -> I, V, O
msphere = MeshSphere(Base=item_2, Radius=Slider(2, range=0..10), UCount=8, VCount=8)
context_bake = ContextBake(Geometry=msphere)
bang = ExplodeTree(Data=zombiesolver.O)
pt_2 = Point(item_2)
item_3 = ListItem(List=bang, Index=0, Wrap=True)
facen = FaceNormals(Mesh=item_3)  # -> Centers, Normals
dist = Distance(PointA=facen.Centers, PointB=pt_2)
bnd = Bounds(Numbers=dist)
number_slider_3 = Slider(100, range=0..100)
remap = Remap(data=dist, min=number_slider, max=number_slider_2)
wbframe = WeaverbirdsPictureFrame(MeshPolylines=item_3, Distance=remap, InsetType=0)
panel = Panel(bnd)
wbcatmullclark = WeaverbirdsCatmullClarkSubdivision(MeshCurves=wbframe, Level=1, SmoothNakedEdges=1)
panel_2 = Panel(remap)
custom_mesh_settings = SettingsCustom(
    StitchSeams=True,
    SimplePlanes=False,
    Refine=True,
    MinCount=number_slider_3,
    MaxCount=number_slider_3,
    AspectRatio=20,
    MaxDistance=0,
    MaxAngle=20,
    MinEdge=0,
    MaxEdge=0)
swatch = ColourSwatch(SwatchColor=RGB(92, 64, 31))
boundary_2 = BoundarySurfaces(Edges=circle)
rh_out_mesh = Mesh(wbcatmullclark)
mesh_2 = MeshBrep(Brep=boundary_2, Settings=custom_mesh_settings)
rh_out_sol_angle = Curve(rot3d.Geometry)
rh_out_sol_ring = Curve(circle)
rh_out_sun = Geometry(msphere)
rh_out_plane = Geometry(mesh_2)
context_bake_2 = ContextBake(SolarAngle=rot3d.Geometry)  # disabled
context_bake_3 = ContextBake(Geometry=circle)  # disabled
context_bake_4 = ContextBake(Geometry=rh_out_mesh)  # disabled

# ==== cluster Remap: Remaps numbers
data = ClusterInput()
min = ClusterInput()
max = ClusterInput()
bnd = Bounds(Numbers=data)
dom = ConstructDomain(DomainStart=min, DomainEnd=max)
remap = RemapNumbers(Value=data, Source=bnd, Target=dom)  # -> Mapped, Clipped
R = ClusterOutput(remap.Mapped)
